# Grasshopper definition CsvReader.gh (Grasshopper 1.0.7)
# plug-ins: Bifocals, EleFront

list = ValueList({"Point": 0, "Curve": 1, "Arc": 2, "Circle": 3, "Ellipse": 4, "Line": 5, "Polyline": 6, "Surface": 7, "Brep": 8, "Mesh": 9, "Polysurface": 10, "Block": 11, "Text": 12, "TextDot": 13, "Dimension": 14, "LinearDimension": 15, "AngularDimension": 16, "Hatch": 17, "Leader": 18}, selected="Block")
list_2 = ValueList({"Point": 0, "Curve": 1, "Arc": 2, "Circle": 3, "Ellipse": 4, "Line": 5, "Polyline": 6, "Surface": 7, "Brep": 8, "Mesh": 9, "Polysurface": 10, "Block": 11, "Text": 12, "TextDot": 13, "Dimension": 14, "LinearDimension": 15, "AngularDimension": 16, "Hatch": 17, "Leader": 18}, selected="Brep")
file_path = Panel("C:\data.csv")
reftype = ReferenceByType(ObjectType=list)
# CLEAN DATA
# Fix data that is:
# -incorrect
# -innacurate
# -incomplete
# -irrelevant
reftype_2 = ReferenceByType(ObjectType=list_2)
deblock = DeconstructBlock(Block=reftype, recursive=True)  # -> Name, Plane, flatten(Geometry)
path = FilePath(file_path)
# TIDY DATA
# Organize data:
# - One variable per column
# - One entry per row
# - One purpose per table
merge = Merge(Data1=flatten(reftype_2), Data2=deblock.Geometry)
split_char = Panel(",")
file = ReadFile(File=path, PerLineParse=True)
rhatt = GetRhinoAttributes(Geometry=merge)  # -> Name, Layer, Color
split = TextSplit(Text=file, Separators=split_char)
txt = Text(rhatt.Layer)
flip = FlipMatrix(Data=split)
cset = CreateSet(List=txt)  # -> Set, Map
split_index = Panel("1")
split_2 = SplitList(List=flip, Index=split_index)  # -> simplify(ListA), simplify(ListB)
cset_2 = CreateSet(List=cset.Map)  # -> Set, Map
mindex = MemberIndex(Set=cset.Map, Member=cset_2.Set)  # -> Index, Count
layer_names = Panel(cset.Set)
item = ListItem(List=merge, Index=mindex.Index, Wrap=True)  # -> simplify(Item)
path_2 = ConstructPath(Indices="6")
path_3 = ConstructPath(Indices="5")
path_4 = ConstructPath(Indices="2")
path_5 = ConstructPath(Indices="4")
path_6 = ConstructPath(Indices="3")
path_7 = ConstructPath(Indices="0")
path_8 = ConstructPath(Indices="1")
lng = ListLength(List=layer_names)
branch = TreeBranch(Tree=split_2.ListB, Path=path_2, MaintainPaths=True)  # -> flatten(Branch)
lng_2 = ListLength(List=item)
# Normally item 0 for each list the column title
panel = Panel("0 to 255")
branch_2 = TreeBranch(Tree=split_2.ListB, Path=path_3, MaintainPaths=True)  # -> flatten(Branch)
panel_2 = Panel(item)
branch_3 = TreeBranch(Tree=split_2.ListB, Path=path_4, MaintainPaths=True)  # -> flatten(Branch)
branch_4 = TreeBranch(Tree=split_2.ListB, Path=path_5, MaintainPaths=True)  # -> flatten(Branch)
branch_5 = TreeBranch(Tree=split_2.ListB, Path=path_6, MaintainPaths=True)  # -> flatten(Branch)
branch_6 = TreeBranch(Tree=split_2.ListB, Path=path_7, MaintainPaths=True)  # -> flatten(Branch)
branch_7 = TreeBranch(Tree=split_2.ListB, Path=path_8, MaintainPaths=True)  # -> flatten(Branch)
random = Random(Range=panel, Number=lng, Seed=250)
random_2 = Random(Range="0 to 255", Number=lng, Seed=2)
panel_3 = Panel(split_2.ListA)
random_3 = Random(Range="0 to 255", Number=lng, Seed=52)
int = Integer(random_3)
int_2 = Integer(random_2)
int_3 = Integer(random)
num = Number(branch_2)
num_2 = Number(branch_4)
num_3 = Number(branch_5)
num_4 = Number(branch_6)
num_5 = Number(branch_3)
num_6 = Number(branch_7)
volume = Volume(Geometry=item)  # -> Volume, Centroid
rgb = ColourRGB(Alpha=255, Red=int_2, Green=int, Blue=int_3)  # -> simplify(graft(Colour))
ma = MassAddition(Input=volume.Volume)  # -> Result, PartialResults
repeat = RepeatData(Data=rgb, Length=lng_2)
panel_4 = Panel(branch)
volumes = Panel(ma.Result)
preview = CustomPreview(Geometry=item, Material=repeat)
tmatch = MatchText(Text=panel_4, Pattern="*paint*", Case=False)
panel_5 = Panel(tmatch)
cull = CullPattern(List=panel_4, CullPattern=tmatch)
keysearch = KeyValueSearch(Keys=branch, Values=num_6, Search=cull)
panel_6 = Panel(cull)
multiplication = Multiplication(A=ma.Result, B=keysearch)
ma_2 = MassAddition(Input=flatten(multiplication))  # -> Result, PartialResults
panel_7 = Panel(ma_2.Result)
